# Dynamo graph Random Single Story Building.dyn (Dynamo 2.1.0.6085)

number_slider = DoubleSlider(10.2, range=0..100 step 0.1)  # graph input
number_slider_2 = DoubleSlider(37.8, range=0..500 step 0.1)  # graph input
byCoordinates = Point.ByCoordinates(x=number_slider, y=number_slider_2)
number_slider_3 = DoubleSlider(20, range=0..3000 step 0.1)  # graph input
number_slider_4 = DoubleSlider(0, range=0..1000 step 0.1)  # graph input
byCoordinates_2 = Point.ByCoordinates(x=number_slider_3, y=number_slider_4)
number_slider_5 = DoubleSlider(0, range=0..100 step 0.1)  # graph input
number_slider_6 = DoubleSlider(0, range=0..500 step 0.1)  # graph input
byCoordinates_3 = Point.ByCoordinates(x=number_slider_5, y=number_slider_6)
number_slider_7 = DoubleSlider(0, range=0..100 step 0.1)  # graph input
number_slider_8 = DoubleSlider(25, range=0..500 step 0.1)  # graph input
byCoordinates_4 = Point.ByCoordinates(x=number_slider_7, y=number_slider_8)
create = List.Create(item0=byCoordinates, item1=byCoordinates_2, item2=byCoordinates_3, item3=byCoordinates_4)
boolean = BoolSelector(true)  # graph input
byPoints = PolyCurve.ByPoints(points=create, connectLastToFirst=boolean)
curves = PolyCurve.Curves(polyCurve=byPoints)
levels = Levels(index=0)  # graph input
levels_2 = Levels(index=1)  # graph input
wall_types = WallTypes(index=20)  # graph input
byCurveAndLevels = Wall.ByCurveAndLevels(c=curves, startLevel=levels, endLevel=levels_2, wallType=wall_types)
flatten = List.Flatten(list=curves)
code_block = CodeBlock { "Generic Roof - 300mm"; }
byName = RoofType.ByName(name=code_block)
levels_3 = Levels(index=1)  # graph input
byOutlineTypeAndLevel = Roof.ByOutlineTypeAndLevel(outline=flatten, roofType=byName, level=levels_3)
floor_types = FloorTypes(index=0)  # graph input
byOutlineTypeAndLevel_2 = Floor.ByOutlineTypeAndLevel(outline=flatten, floorType=floor_types, level=levels)
number = DoubleInput(1)
byCoordinates_5 = Vector.ByCoordinates(z=number)
categories = Categories(index=589)
all_elements_of_category = ElementsOfCategory(Category=categories)
family_types = FamilyTypes(index=150)
getLocation = Element.GetLocation(element=all_elements_of_category)
integer_slider = IntegerSlider(6, range=0..10 step 1)
pointsAtEqualChordLength = Curve.PointsAtEqualChordLength(curve=getLocation, divisions=integer_slider)
X = Point.X(point=pointsAtEqualChordLength)
Y = Point.Y(point=pointsAtEqualChordLength)
Z = Point.Z(point=pointsAtEqualChordLength)
integer_slider_2 = IntegerSlider(3, range=0..10 step 1)
add = Z + integer_slider_2
byCoordinates_6 = Point.ByCoordinates(x=X, y=Y, z=add)
byPoints_2 = Custom[Springs.HostedInstance.ByPoints](host=all_elements_of_category, type=family_types, point=byCoordinates_6)  # Creates hosted family instances(doors/windows) at the specified points. You can feed either a single family type or a unique type for each instance.
